# Grasshopper definition meArm_InverseKinematics.gh (Grasshopper 1.0.7)
# plug-ins: Firefly.Core

# ---- group: Use this if your arm dimension are different
crv = Curve(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)
crv_2 = Curve(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)
crv_3 = Curve(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)
crv_4 = Curve(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)
crv_5 = Curve(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)
crv_6 = Curve(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)
crv_7 = Curve(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)
crv_8 = Curve(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)
crv_9 = Curve(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)
customme = CustomSkeleton(
    gripper=crv_3,
    top_link=crv_6,
    main_link=crv_4,
    elbow=crv_7,
    left_link=crv,
    left=crv_8,
    right=crv_5,
    stablizer=crv_9,
    base=crv_2)

# ---- group: Generate target
crv_10 = Curve(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)
curvepoint = PointOnCurve(crv_10, parameter=0)

# ----
mearm = MeArmIK(Target=curvepoint)  # -> Crv, Txt; inputs Target: Point3d, Custom: tree of Polyline
# ---------- mearm: C# usings ----------
using System.Linq;
using System.Text;
using System.Windows.Forms;
# ---------- mearm: C# ----------
    this.Component.Name = "MeArm IK";
    this.Component.NickName = "MeArm";
    this.Component.Description = "IK Solver for MeArm";
    this.Component.Params.Input[0].Description = "Point Target for IK calculations";
    this.Component.Params.Input[1].Description = "Use custom skeleton for IK calculations";
    this.Component.Params.Output[0].Description = "Simplified Skeleton representation";
    this.Component.Params.Output[1].Description = "Serial data to be send to Arduino";

    double[,] dhpt = new double[4, 4]{
      {0,-Math.PI / 2,15,73},
      {0,0,80,0},
      {0,0,80,0},
      {0,Math.PI / 2,52.5,0}};
    double delta = 5.7;
    if(this.Component.Params.Input[1].SourceCount != 0)
    {
      Point3d[] pts = Custom.Branch(8)[0].ToArray();
      double[] z = new double[pts.Length];
      for(int j = 0; j < pts.Length;j++){
        z[j] = pts[j].Z;
      }
      Array.Sort(z, pts);
      Point3d[] pts2 = Custom.Branch(0)[0].ToArray();
      double[] x = new double[pts2.Length];
      for(int j = 0; j < pts2.Length;j++){
        x[j] = pts2[j].X;
      }
      Array.Sort(x, pts2);
      delta = pts2[0].Z - pts2.Last().Z;
      dhpt = new double[4, 4]{
        {0,-Math.PI / 2,pts[2].X,pts[2].Z},
        {0,0,Custom.Branch(6)[0].Length,0},
        {0,0,Custom.Branch(2)[0].GetSegments()[0].Length > Custom.Branch(2)[0].GetSegments()[1].Length ? Custom.Branch(2)[0].GetSegments()[0].Length : Custom.Branch(2)[0].GetSegments()[1].Length,0},
        {0,Math.PI / 2,pts2.Last().X - pts2[0].X,0}};
    }
    Target.Z += delta;

    double t0 = Math.Atan2(Target.Y, Target.X);
    double s3 = Math.Sqrt(Target.X * Target.X + Target.Y * Target.Y) - dhpt[0, 2] - dhpt[3, 2];
    double s4 = Target.Z - dhpt[0, 3];
    double l2 = s4 * s4 + s3 * s3;
    double t1 = Math.Acos((dhpt[2, 2] * dhpt[2, 2] - dhpt[1, 2] * dhpt[1, 2] - l2) / (-2 * dhpt[1, 2] * Math.Sqrt(l2))) + Math.Atan2(s4, s3);
    double t2 = Math.PI - Math.Acos((l2 - dhpt[1, 2] * dhpt[1, 2] - dhpt[2, 2] * dhpt[2, 2]) / (-2 * dhpt[1, 2] * dhpt[2, 2]));

    if(double.IsNaN(t2) || t0 > Math.PI / 2 || t0 < -Math.PI / 2 || t1 < 0 || t1 > 180 || t1 - t2 >= 0)
    {
      Txt = "ERROR";
      return;
    }
    Txt = Serial(t0, t1, t2);

    dhpt[0, 0] = t0;
    dhpt[1, 0] = -t1;
    dhpt[2, 0] = t2;
    dhpt[3, 0] = t1 - t2;

    double[,] h01 = DHTM(dhpt, 0);
    double[,] h12 = DHTM(dhpt, 1);
    double[,] h23 = DHTM(dhpt, 2);
    double[,] h34 = DHTM(dhpt, 3);

    double[,] h02 = Dot(h01, h12);
    double[,] h03 = Dot(h02, h23);
    double[,] h04 = Dot(h03, h34);
    h04[2, 3] -= delta;

    Point3d[] pt = new Point3d[5]{
      new Point3d(0, 0, 0),
      new Point3d(0, 0, 0),
      new Point3d(0, 0, 0),
      new Point3d(0, 0, 0),
      new Point3d(0, 0, 0),
      };
    pt[1].Transform(Transform.ChangeBasis(new Plane(new Point3d(h01[0, 3], h01[1, 3], h01[2, 3]), new Vector3d(h01[0, 0], h01[1, 0], h01[2, 0]), new Vector3d(h01[0, 1], h01[1, 1], h01[2, 1])), Plane.WorldXY));
    pt[2].Transform(Transform.ChangeBasis(new Plane(new Point3d(h02[0, 3], h02[1, 3], h02[2, 3]), new Vector3d(h02[0, 0], h02[1, 0], h02[2, 0]), new Vector3d(h02[0, 1], h02[1, 1], h02[2, 1])), Plane.WorldXY));
    pt[3].Transform(Transform.ChangeBasis(new Plane(new Point3d(h03[0, 3], h03[1, 3], h03[2, 3]), new Vector3d(h03[0, 0], h03[1, 0], h03[2, 0]), new Vector3d(h03[0, 1], h03[1, 1], h03[2, 1])), Plane.WorldXY));
    pt[4].Transform(Transform.ChangeBasis(new Plane(new Point3d(h04[0, 3], h04[1, 3], h04[2, 3]), new Vector3d(h04[0, 0], h04[1, 0], h04[2, 0]), new Vector3d(h04[0, 1], h04[1, 1], h04[2, 1])), Plane.WorldXY));
    Crv = new Polyline(pt);
# ---------- mearm: C# additional code ----------
  string Serial(double t0, double t1, double t2)
  {
    return Math.Round((t0 * 180 / Math.PI) + 90) + ","
      + Math.Round((Math.PI - t1) * (180 / Math.PI)) + ","
      + Math.Round((Math.PI - (t2 - t1)) * 180 / Math.PI);
  }
  double[,] DHTM(double[,] dhpt, int r)
  {
    return new double[4, 4]{
      {Math.Cos(dhpt[r, 0]), -Math.Sin(dhpt[r, 0]) * Math.Cos(dhpt[r, 1]), Math.Sin(dhpt[r, 0]) * Math.Sin(dhpt[r, 1]), dhpt[r, 2] * Math.Cos(dhpt[r, 0])},
      {Math.Sin(dhpt[r, 0]), Math.Cos(dhpt[r, 0]) * Math.Cos(dhpt[r, 1]), -Math.Cos(dhpt[r, 0]) * Math.Sin(dhpt[r, 1]), dhpt[r, 2] * Math.Sin(dhpt[r, 0])},
      {0, Math.Sin(dhpt[r, 1]), Math.Cos(dhpt[r, 1]), dhpt[r, 3]},
      {0, 0, 0, 1}};
  }

  double[,] Dot(double[,] A, double[,] B)
  {
    int rA = A.GetLength(0);
    int cA = A.GetLength(1);
    int rB = B.GetLength(0);
    int cB = B.GetLength(1);
    double sum;
    double[,] result = new double[rA, cB];
    for (int i = 0; i < rA; i++)
    {
      for (int j = 0; j < cB; j++)
      {
        sum = 0;
        for(int k = 0;k < cA;k++)
        {
          sum += A[i, k] * B[k, j];
        }
        result[i, j] = sum;
      }
    }
    return result;
  }
# ---------- end mearm ----------

# ---- group: Manual Gripper Control Append gripper value
list = ValueList({"Gripper Open": 90, "Gripper Close": 120}, selected="Gripper Close")
merge = Merge(Data1=mearm.Txt, Data2=list)
join = TextJoin(Text=merge, Join=",")

# ---- group: Serial Message Uses Firefly plugin
toggle = BooleanToggle(False)
ports_available = COMPortsAvailable()
write = SerialWriteGeneric(StartWritingValues=toggle, WriteData=join, PortNumber=ports_available)  # -> ArduinoOutput, StatusMessage
open_port = OpenClosePort(OpenClosePort=toggle, PortNumber=ports_available, BaudRate="9600")

# ==== cluster CustomSkeleton: Define custom skeleton for MeArm IK
left = ClusterInput()  # Left motor angle (Line)
left_link = ClusterInput()  # Link between left servo and main link (Line)
right = ClusterInput()  # Right motor angle (Line)
stablizer = ClusterInput()  # Stable link between right and elbow triangle (Line)
base = ClusterInput()  # ZigZag curve that looks like a 7 representing the base and center of rotation (3 segment Polyline)
elbow = ClusterInput()  # Triangle that acts as the elbow (Closed Polyline)
gripper = ClusterInput()  # Triangle Representing Gripper (Closed Polyline)
main_link = ClusterInput()  # Main link between gripper and elbow (2 segment Polyline)
top_link = ClusterInput()  # Top link between the gripper and elbow (Line)
entwine = Entwine(
    Branch00=gripper,
    Branch01=top_link,
    Branch02=main_link,
    Branch03=elbow,
    Branch04=left_link,
    Branch05=left,
    Branch06=right,
    Branch07=stablizer,
    Branch08=base,
    FlattenInputs=True)
join = JoinCurves(Curves=entwine, Preserve=False)
custom_skeleton = ClusterOutput(join)  # Custom Skeleton for MeArm IK
